# Grasshopper definition Cantilever.gh (Grasshopper 1.0.8)
# Copyright: hrntsm
# plug-ins: MeshEdit Components, Lemur Info, IguanaMesh

number_slider = Slider(100, range=0..100)
ilineartetraprism = ILinearTetraPrism(
    MinimumSize=number_slider,
    MaximunSize=number_slider,
    CurvatureAdapt=False,
    MinimumElements=6,
    Optimization=0,
    QualityType=2,
    QualityThreshold=0.3,
    Massive_Refinement=False)
brep = Brep(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)
ifillbrep = IFillBrep(Brep=brep, ISettings=ilineartetraprism)  # -> IMesh, Entities, Info
lefi = LeMeshFromIMesh(Header="Cantilever", IMesh=ifillbrep.IMesh)  # -> LeMesh, Mesh
conlecnt = ConstructLeControl()
unifynormals = MeshUnifyNormals(Mesh=lefi.Mesh)
conleasm = ConstructLeAssemble(LeMesh=lefi.LeMesh, LeCnt=conlecnt)
path = FilePath("C:\Users\hiroa\Desktop\lemur_test\")
leexe = LeExecute(LeAssemble=conleasm, Thread="-1", Dir=path, Run=Toggle(False))
previn = PreviewInput(LeAssemble=conleasm)  # -> Msh, Control, Hec
panel = Panel(previn.Hec)
panel_2 = Panel(previn.Control)
panel_3 = Panel(previn.Msh)
